# Grasshopper definition outdoor_airflow.gh (Grasshopper 0.9.76)
# plug-ins: Python Interpreter

wall = Butterfly_WallBoundary(refLevels="(1, 6)")  # -> wallBoundary; plug-in component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
# 1. Wind Tunnel Parameters
panel = Panel("{30,5,10}")
# 0. Create BF surface
brep = Brep([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])
jagged = SettingsSpeed()
preview = CustomPreview(
    Geometry=brep,
    Shader={ambient=RGB(0, 0, 0), diffuse=RGB(255, 105, 180), emission=RGB(76, 32, 54), shine=0.5, specular=RGB(255, 255, 255), transparency=0})
windtunnelpar = Butterfly_WindTunnelParameters(windwardX=3, topX=3, sidesX=2, leewardX=15, nDivXYZ=panel, gradXYZ="{3,1,2}")  # -> readMe, tunnelPar; plug-in component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
# Outdoor Study
createbfsurface = Butterfly_CreateButterflySurface(geo=brep, name="buildings", boundary=wall, meshSet=jagged)  # -> readMe, BFSrf; plug-in component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
# 2. Create the Wind Tunnel
panel_2 = Panel("outdoors_airflow")
vec = Vector(Vector(47.94345108, 59.67856447, 0))
vdis = VectorDisplay(Anchor=Point(0, 0, 0), Vector=vec)
createcasefromtunnel = Butterfly_CreateCaseFromTunnel(
    name=panel_2,
    BFSurfaces=createbfsurface.BFSrf,
    windSpeed="2",
    refWindHeight=10,
    landscape=1,
    globalRefLevel="(2, 10)",
    tunnelPar=windtunnelpar.tunnelPar,
    run=Toggle(False))  # -> readMe, geo, case; plug-in component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
panel_3 = Panel(createcasefromtunnel.readMe)
wires = BrepWireframe(Brep=createcasefromtunnel.geo, Density=-1)
# purgeCase
purgecase = Butterfly_purgeCase(case=createcasefromtunnel.case, blockMesh=False, snappyHexMesh=False, results=False)  # -> readMe; plug-in component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
# 1.2. update fvScheme based on
# mesh orthogonality
toggle = BooleanToggle(False)
brep_2 = Brep(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)
gentestpts = Honeybee_GenerateTestPoints(testGeometry=brep_2, gridSize=Slider(1, range=0..1), distBaseSrf="0", moveTestMesh=Toggle(False))  # -> readMe, simplify(testPoints), simplify(ptsVectors), simplify(facesArea), simplify(mesh); plug-in component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
# Load mesh/points
toggle_2 = BooleanToggle(False)
flatten = FlattenTree(Tree=gentestpts.testPoints, Path="{0}")

# ----
# 0. blockMesh
# 1. snappyHexMesh
# 2. simpleFOAM
# This will eventually change to a recipe,
toggle_3 = BooleanToggle(True)
snappyhexmeshdict = Butterfly_snappyHexMeshDict(castellatedMesh=True, snap=True, addLayers=False, maxGlobalCells=2000000)  # -> snappyHexMeshDict; plug-in component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
blockmesh = Butterfly_blockMesh(case=createcasefromtunnel.case, purge=toggle_3, run=Toggle(False))  # -> readMe, case; plug-in component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
snappyhexmesh = Butterfly_snappyHexMesh(case=blockmesh.case, snappyHexMeshDict=snappyhexmeshdict, run=Toggle(False))  # -> out, case; plug-in component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
panel_4 = Panel("""U
p""")
controldict = Butterfly_controlDict(startTime=0, endTime=Slider(2000, range=0..10000), writeInterval=100, writeCompression=False)  # -> controlDict; plug-in component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
residualcontrol = Butterfly_residualControl(p="0.0001", U="0.0001", k="0.0001", epsilon="0.0001")  # -> residualControl; plug-in component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
probes = Butterfly_probes(pts=flatten, fields=panel_4)  # -> probes; plug-in component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

panel_5 = Panel(blockmesh.readMe)
# 1.1. checkMesh
chekmesh = Butterfly_chekMesh(case=snappyhexmesh.case, run=Toggle(False))  # -> readMe, case, maxNonOrthogonality; plug-in component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
updatefvschemes = Butterfly_UpdateFvSchemes(case=chekmesh.case, orthogonality=chekmesh.maxNonOrthogonality, run=toggle)  # -> readMe, case; plug-in component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
# Mesh and run the case
panel_6 = Panel(chekmesh.readMe)

# ---- group: case
data = Data(snappyhexmesh.case)

# ----
loadmesh = Butterfly_LoadMesh(case=data, load=toggle_2)  # -> mesh; plug-in component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
loadpoints = Butterfly_LoadPoints(case=data, load=Toggle(False))  # -> pts; plug-in component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

# ---- group: execute the case - simpleFoam for now
simplefoam = Butterfly_simpleFoam(case=chekmesh.case, controlDict=controldict, residualControl=residualcontrol, probes=probes, run=Toggle(False))  # -> readMe, case; plug-in component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

# ----
data_2 = Data(simplefoam.case)
loadprobes = Butterfly_LoadProbes(case=data_2, field="p")  # -> skippedPoints, values; plug-in component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
loadprobes_2 = Butterfly_LoadProbes(case=data_2, field="U")  # -> skippedPoints, values; plug-in component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
pt = Point(loadprobes.skippedPoints)
# Results visualization
panel_7 = Panel(pt)
flatten_2 = FlattenTree(Tree=gentestpts.mesh, Path="{0}")

# ---- group: points
pt_2 = Point(flatten)

# ---- group: vectors
vec_2 = Vector(loadprobes_2.values)

# ----
mjoin = MeshJoin(Meshes=flatten_2)

vlen = VectorLength(Vector=vec_2)
bnd = Bounds(Numbers=vlen)
scale = Slider(0.27, range=0..1)
remap = RemapNumbers(Value=vlen, Source=bnd, Target=Domain(0, 1))  # -> Mapped, Clipped
gradient = Gradient(LowerLimit=0, UpperLimit=1, Parameter=remap.Mapped, stops=[0.15: RGB(255, 130, 160), 0.85: RGB(220, 0, 40)])
multiplication = Multiplication(A=vec_2, B=scale)
vdisex = VectorDisplayEx(Point=pt_2, Vector=multiplication, Colour=gradient, Width=Slider(2, range=0..5))

ladybug = Ladybug_Ladybug()  # -> Vviiiiiiiiiizzz; plug-in component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
recolormesh = Ladybug_RecolorMesh(analysisResult=loadprobes.values, inputMesh=mjoin, analysisTitle="pressure", legendTitle="Pa")  # -> readMe, newMesh, newLegend, legendBasePt, meshColors, legendColors; plug-in component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
